# Grasshopper definition 3dbarchart.gh (Grasshopper 1.0.7)
# plug-ins: LunchBox, Hops

hops = Hops(
    CacheResultsInMemory=False,
    CacheSolveResults=False,
    RemoteDefinitionLocation="http://127.0.0.1:5000/imft",
    RemoteSolveVersion=(0, 1, 0),
    ShowInput_Enabled=False,
    ShowInput_Path=False,
    SynchronousSolve=True)
curve = Curve(hops)
polygon_center = PolygonCenter(Polyline=curve)  # -> CenterV, CenterE, CenterA
average = Average(Input=polygon_center.CenterV)
scale = Scale(Geometry=curve, Center=average, Factor=Slider(100000, range=0..100000))  # -> Geometry, Transform
curve_2 = Curve(scale.Geometry)
list_length = ListLength(List=curve_2)
subtraction = Subtraction(A=Slider(1, range=0..1), B=Slider(0.05, range=0..1))
multiplication = Multiplication(A=list_length, B=subtraction)
round = Round(Number=multiplication)  # -> Nearest, Floor, Ceiling
random_reduce = RandomReduce(List=curve_2, Reduction=round.Nearest, Seed=1)
curve_3 = Curve(random_reduce)
list_length_2 = ListLength(List=curve_3)
repeat_data = RepeatData(Data=list_length_2, Length=Slider(4, range=0..10))
construct_domain = ConstructDomain(DomainStart=Slider(0.5, range=0..100), DomainEnd=Slider(6, range=0..100))
panel = Panel("""0
1
2
3""")
random = Random(Range=construct_domain, Number=graft(repeat_data), Seed=graft(panel))
number_slider = Slider(10, range=0..10)
multiplication_2 = Multiplication(A=random, B=number_slider)
round_2 = Round(Number=multiplication_2)  # -> Nearest, Floor, Ceiling
division = Division(A=round_2.Nearest, B=number_slider)
flip_matrix = FlipMatrix(Data=division)  # -> simplify(Data)
panel_2 = Panel(flip_matrix)
list_item = ListItem(List=flip_matrix, Index=0, Wrap=True)  # -> Item, Item1, Item2, Item3
addition = Addition(A=list_item.Item, B=list_item.Item1)
addition_2 = Addition(A=addition, B=list_item.Item2)
addition_3 = Addition(A=addition_2, B=list_item.Item3)
data = Data(flip_matrix)
merge = Merge(Data1=list_item.Item, Data2=addition, Data3=addition_2, Data4=addition_3)
panel_3 = Panel(merge)
unit_z = UnitZ(Factor=1)
amplitude = Amplitude(Vector=unit_z, Amplitude=merge)
move = Move(Geometry=graft(curve_3), Motion=amplitude)  # -> Geometry, Transform
cull_index = CullIndex(List=move.Geometry, Indices="-1", Wrap=True)
insert_items = InsertItems(List=graft(curve_3), Item=cull_index, Indices="1", Wrap=True)
panel_4 = Panel(data)
unit_z_2 = UnitZ(Factor=1)
amplitude_2 = Amplitude(Vector=unit_z_2, Amplitude=data)
extrude = Extrude(Base=insert_items, Direction=amplitude_2)
cap_holes = CapHoles(Brep=extrude)
list_item_2 = ListItem(List=cap_holes, Index=0, Wrap=True)  # -> Item, Item1, Item2, Item3
colour_picker = ColourPicker(PickedColour=RGB(42, 255, 0))
colour_picker_2 = ColourPicker(PickedColour=RGB(255, 217, 0))
colour_picker_3 = ColourPicker(PickedColour=RGB(255, 106, 0))
colour_picker_4 = ColourPicker(PickedColour=RGB(255, 0, 0))
custom_preview = CustomPreview(Geometry=list_item_2.Item, Material=colour_picker)
custom_preview_2 = CustomPreview(Geometry=list_item_2.Item1, Material=colour_picker_2)
custom_preview_3 = CustomPreview(Geometry=list_item_2.Item2, Material=colour_picker_3)
custom_preview_4 = CustomPreview(Geometry=list_item_2.Item3, Material=colour_picker_4)
boolean_toggle = BooleanToggle(False)
object_bake = ObjectBake(
    BakeToggle=boolean_toggle,
    GeometryObjects=list_item_2.Item,
    Layer="green",
    ObjectName="GH_Obj",
    ObjectColor=colour_picker,
    LayerColor="0, 127, 0")
object_bake_2 = ObjectBake(
    BakeToggle=boolean_toggle,
    GeometryObjects=list_item_2.Item1,
    Layer="yellow",
    ObjectName="GH_Obj",
    ObjectColor=colour_picker_2,
    LayerColor="255, 255, 0")
object_bake_3 = ObjectBake(
    BakeToggle=boolean_toggle,
    GeometryObjects=list_item_2.Item2,
    Layer="orange",
    ObjectName="GH_Obj",
    ObjectColor=colour_picker_3,
    LayerColor="255, 127, 0")
object_bake_4 = ObjectBake(
    BakeToggle=boolean_toggle,
    GeometryObjects=list_item_2.Item3,
    Layer="red",
    ObjectName="GH_Obj",
    ObjectColor=colour_picker_4,
    LayerColor="255, 0, 0")
